# Grasshopper definition noised_shell.gh (Grasshopper 1.0.7)
# plug-ins: Kangaroo2 Components, Noise 4D

# ----
# input
geo = Geometry([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])
geo_2 = Geometry([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])

area = Area(Geometry=geo)  # -> Area, Centroid
geo_3 = Geometry(geo)
scale = Scale(Geometry=geo_3, Center=area.Centroid, Factor=Slider(0.5, range=0..1))  # -> Geometry, Transform
custom_mesh_settings = SettingsCustom(
    StitchSeams=True,
    SimplePlanes=False,
    Refine=True,
    MinCount=16,
    MaxCount=400,
    AspectRatio=20,
    MaxDistance=0,
    MaxAngle=20,
    MinEdge=0,
    MaxEdge=Slider(5, range=0..10))
geo_4 = Geometry(scale.Geometry)
boundary = BoundarySurfaces(Edges=[geo_2, geo_4])
mesh = MeshBrep(Brep=boundary, Settings=custom_mesh_settings)
show = Show(G=mesh)
medges = MeshEdges(Mesh=mesh)  # -> NakedEdges, InteriorEdges, NonManifoldEdges
demesh = DeconstructMesh(Mesh=mesh)  # -> Vertices, Faces, Colours, Normals
edgelengths = EdgeLengths(Mesh=mesh, LengthFactor=1, Strength=1)
geo_5 = Geometry(medges.NakedEdges)
join = JoinCurves(Curves=geo_5, Preserve=False)
load = Load(Point=demesh.Vertices, ForceVector=Vector(0, 0, 1), Weighting=1)
len = Length(Curve=join)
sort = SortList(Keys=len, ValuesA=join)  # -> Keys, reverse(ValuesA)
item = ListItem(List=sort.ValuesA, Index=0, Wrap=True)  # -> Item, Item1
cull_i = CullIndex(List=sort.ValuesA, Indices=["0", "1"], Wrap=True)
explode = Explode(Curve=cull_i, Recursive=True)  # -> Segments, Vertices
explode_2 = Explode(Curve=[item.Item, item.Item1], Recursive=True)  # -> Segments, Vertices
Z = UnitZ(Factor=Slider(10, range=0..10))
geo_6 = Geometry(flatten(explode.Vertices))
anchor = Anchor(Point=flatten(explode_2.Vertices), Strength=10000)
move = Move(Geometry=flatten(geo_6), Motion=Z)  # -> Geometry, Transform
anchor_2 = Anchor(Point=flatten(geo_6), Target=move.Geometry, Strength=10000)
data = Data(show)
data_2 = Data(edgelengths)
merge = Merge(Data1=data, Data2=anchor_2, Data3=data_2, Data4=anchor)  # -> flatten(Result)
solver = Solver(GoalObjects=merge, Reset=Button(), Threshold=1e-15, Tolerance=0.0001, On=Toggle(False))  # -> I, V, O
mesh_2 = Mesh(flatten(solver.O))
clean = CleanTree(RemoveNulls=True, RemoveInvalid=True, RemoveEmpty=True, Tree=mesh_2)
geo_7 = Geometry(clean)

# ----
# noise
number_slider = Slider(0.2, range=0.2..5)
demesh_2 = DeconstructMesh(Mesh=geo_7)  # -> Vertices, Faces, Colours, Normals
simplex = SimplexNoise(Values=demesh_2.Vertices, Time=0, Scale=number_slider)
number_slider_2 = Slider(1.2, range=0.1..1.2)
multiplication = Multiplication(A=simplex, B=demesh_2.Normals)
multiplication_2 = Multiplication(A=multiplication, B=Slider(2.5, range=0..10))
gradient = Gradient(LowerLimit=0, UpperLimit=1, Parameter=multiplication_2, stops=[0: RGB(255, 255, 255), 1: RGB(204, 204, 204)])
addition = Addition(A=demesh_2.Vertices, B=multiplication_2)
conmesh = ConstructMesh(Vertices=addition, Faces=demesh_2.Faces, Colours=gradient)
